# Grasshopper definition scanGenerator.gh (Grasshopper 0.9.76)
# plug-ins: Python Interpreter, BullAnt

xy = XYPlane(Origin=Point(0, 0, 0))
gggd = GgGeoDome(
    Origin=xy,
    Radius=Slider(10, range=0..10),
    Class=0,
    Bucky=Toggle(False),
    Freq=Slider(2, range=0..10),
    Lines=False,
    BuckyCL=1)
cp = ControlPoints(Curve=gggd)  # -> Points, Weights, Knots
cullpt = CullDuplicates(Points=flatten(cp.Points), Tolerance=Slider(0, range=0..0.01), CullMode=3)  # -> Points, Indices, Valence
polar = ToPolar(Point=cullpt.Points, System=PlaneXY(0, 0, 0))  # -> Phi, Theta, Radius
entwine = Entwine(Branch00=polar.Phi, Branch01=polar.Theta, FlattenInputs=True)
flip = FlipMatrix(Data=entwine)
deg = Degrees(Radians=entwine)
deg_2 = Degrees(Radians=flip)
bang = ExplodeTree(Data=deg)  # -> Branch0, Branch1
expression = Expression(x=bang.Branch0, y=bang.Branch1, Expression="Format(\"{0},{1}\", x, y)")
panel = Panel(deg)
panel_2 = Panel(deg_2)
bnd = Bounds(Numbers=[Slider(0, range=0..1), Slider(10, range=0..10)])
subset = SubList(List=expression, Domain=bnd, Wrap=True)  # -> List, Index
panel_3 = Panel(expression)
timer = Timer(TimerInterval=10000, Target=gh2jsonviapython)  # disabled
gh2jsonviapython = PythonScript(lines=subset.List, fileAddress="pyOut.json")  # -> out; inputs lines: list
# ---------- gh2jsonviapython: Python ----------
import Rhino as rc

output = open(fileAddress, 'w')

output.write('[')

for line in lines:
    line = line.strip()
    ngles = line.split(',')
    output.write('{' + '"x":' + ngles[0] + ',"y":' + ngles[1] + '},')

output.write(']')

output.close
# ---------- end gh2jsonviapython ----------
panel_4 = Panel(gh2jsonviapython)
